# Dynamo custom node Q_Element.JoinGeometry.dyf "JoinGeometry" (Dynamo 2.3.0.5885)
# category: My Custom Note
# AutoJoinGeometry Custom

element1 = Input(element1: var[]..[])
element2 = Input(element2: var[]..[])
python_script = Python(IN[0]=element1, IN[1]=element2)
# ---------- python_script.python (33 lines) ----------
import clr
clr.AddReference('RevitAPI')
from Autodesk.Revit.DB import *
from System.Collections.Generic import *
clr.AddReference("RevitServices")
import RevitServices
from RevitServices.Persistence import DocumentManager
from RevitServices.Transactions import TransactionManager

doc = DocumentManager.Instance.CurrentDBDocument
items1 = UnwrapElement(IN[0])
items2 = UnwrapElement(IN[1])
## Custom Join uu tien join elementA
def JoinGeometry(doc, item1, item2):
	try:
		JoinGeometryUtils.JoinGeometry(doc,item1,item2)
		if JoinGeometryUtils.IsCuttingElementInJoin(doc,item2,item1):
			JoinGeometryUtils.SwitchJoinOrder(doc,item1,item2)
		return True
	except:
		if JoinGeometryUtils.AreElementsJoined(doc,item2,item1):
			if JoinGeometryUtils.IsCuttingElementInJoin(doc,item2,item1):
				JoinGeometryUtils.SwitchJoinOrder(doc,item1,item2)
		return False
##
TransactionManager.Instance.EnsureInTransaction(doc)
if isinstance(IN[0], list):
	if isinstance(IN[1], list): OUT = [JoinGeometry(doc, x, y) for x, y in zip(items1, items2)]
	else: OUT = [JoinGeometry(doc, x, items2) for x in items1]
else:
	if isinstance(IN[1], list): OUT = [JoinGeometry(doc, items1, x) for x in items2]
	else: OUT = JoinGeometry(doc, items1, items2)
TransactionManager.Instance.TransactionTaskDone()
# ----------------------------------------
success = Output(python_script)
element1_2 = Output(element1)  # "element1"
element2_2 = Output(element2)  # "element2"
