# Dynamo graph Rvt2020_Cut Floor By Pick 2 Point.dyn "Rvt2023_Cut Floor By Pick 2 Point" (Dynamo 2.3.0.5885)
# packages: archi-lab.net 2023.213.1722

python_script = Python()
# ---------- python_script.python (49 lines) ----------
import clr
import sys
import System

clr.AddReference('RevitAPI')
import Autodesk
from Autodesk.Revit.DB import *
import Autodesk.Revit.DB as DB

clr.AddReference('RevitAPIUI')
from Autodesk.Revit.UI import *
from Autodesk.Revit.UI.Selection import *

from System.Collections.Generic import List

clr.AddReference('RevitNodes')
import Revit
clr.ImportExtensions(Revit.GeometryConversion)

clr.AddReference('RevitServices')
import RevitServices
from RevitServices.Persistence import DocumentManager
from RevitServices.Transactions import TransactionManager
list = []

doc = DocumentManager.Instance.CurrentDBDocument
uidoc = DocumentManager.Instance.CurrentUIApplication.ActiveUIDocument

sel = uidoc.Selection
h = sel.PickObject(ObjectType.Element)
e1 = doc.GetElement(h)
#element = doc.GetElement(elementId)
# Pick a point in Revit with the mouse
pickedPoint1 = uidoc.Selection.PickPoint()
pickedPoint2 = uidoc.Selection.PickPoint()

# Convert Revit XYZ point to Dynamo point
dynamoPoint1 = pickedPoint1.ToPoint()
dynamoPoint2 = pickedPoint2.ToPoint()
#list.append(dynamoPoint1)
#list.append(dynamoPoint2)
line = Line.CreateBound(pickedPoint1, pickedPoint2)
dynamo_curve = line.ToProtoType()
list.append(e1)
list.append(dynamo_curve)
list.append(dynamoPoint1)


OUT = list
# ----------------------------------------
code_block = CodeBlock(a=python_script) { a[0]; }
geometry = Element.Geometry(element=code_block)
explode = Geometry.Explode(geometry=geometry)
flatten = List.Flatten(list=explode)
code_block_2 = CodeBlock { 0.5; }
pointAtParameter = Surface.PointAtParameter(surface=flatten, u=code_block_2, v=code_block_2)
Z = Point.Z(point=pointAtParameter)
maximumItem = List.MaximumItem(list=Z)
eq = Z == maximumItem
filterByBoolMask = List.FilterByBoolMask(list=flatten, mask=eq)
code_block_3 = CodeBlock(a=python_script) { a[1]; }
code_block_4 = CodeBlock(a=python_script) { a[2]; }
ZAxis = Vector.ZAxis()
code_block_5 = CodeBlock { 10; }
translate = Geometry.Translate(geometry=code_block_4, direction=ZAxis, distance=code_block_5)
byLineAndPoint = Plane.ByLineAndPoint(line=code_block_3, point=translate)
split = Geometry.Split(geometry=filterByBoolMask.in, other=byLineAndPoint)
flatten_2 = List.Flatten(list=split)
perimeterCurves = Surface.PerimeterCurves(surface=flatten_2)
code_block_6 = CodeBlock(a=code_block) { a; }
type = archilab.Revit.Elements.Elements.Type(element=code_block_6)
code_block_7 = CodeBlock { "Level"; }
getParameterValueByName = Element.GetParameterValueByName(element=code_block_6, parameterName=code_block_7)
byOutlineTypeAndLevel = Floor.ByOutlineTypeAndLevel(outlineCurves=perimeterCurves, floorType=type, level=getParameterValueByName)
count = List.Count(list=byOutlineTypeAndLevel)
code_block_8 = CodeBlock { 1; }
gt = count > code_block_8
if_ = If(test=gt, true=code_block_6, false=byOutlineTypeAndLevel)
delete = archilab.Revit.Elements.Elements.Delete(element=if_)
